# Grasshopper definition forma-api.gh (Grasshopper 1.0.7)
# Copyright: 2024
# plug-ins: Formicae, Swiftlet, jSwan, ProceduralCS

panel = Panel("https://app.autodeskforma.eu/designmode/pro_74nzjy4r4h/03ac9e63-182e-41b2-b5af-81e7b3ee2088")
pipeline = GeometryPipeline(
    GroupByLayer=False,
    GroupByType=False,
    IncludeHidden=True,
    IncludeLocked=True,
    LayerFilter="Forma::Box",
    NameFilter="*",
    SublayerFiltering=True,
    TypeFilter=1073741848)
pipeline_2 = GeometryPipeline(
    GroupByLayer=False,
    GroupByType=False,
    IncludeHidden=True,
    IncludeLocked=True,
    LayerFilter="Forma::Terrain",
    NameFilter="*",
    SublayerFiltering=True,
    TypeFilter=32)
pipeline_3 = GeometryPipeline(
    GroupByLayer=False,
    GroupByType=False,
    IncludeHidden=True,
    IncludeLocked=True,
    LayerFilter="Forma::Buildings",
    NameFilter="*",
    SublayerFiltering=True,
    TypeFilter=1073741880)
auth = Auth(Trigger=Button())
nickname = CreateSimulationBox(Box=pipeline, TerrainMesh=pipeline_2, BuildingsBreps=pipeline_3)  # -> ApiBuilding, ApiTerrain, ApiMin, ApiMax
clean = CleanTree(RemoveNulls=True, RemoveInvalid=True, RemoveEmpty=False, Tree=auth)
data = Data(flatten(clean))
python = GhPythonScript()  # -> out, key, value
# ---------- python: Python ----------
import rhinoscriptsyntax as rs

ghenv.Component.Message = "x-ads-region"


key = "x-ads-region"
value = "EMEA"
# ---------- end python ----------
python_2 = GhPythonScript(url=panel)  # -> out, key, value
# ---------- python_2: Python ----------
import rhinoscriptsyntax as rs

ghenv.Component.Message = "authcontext"
urlParts = url.split("/")

key = "authcontext"
value = urlParts[-2]
# ---------- end python_2 ----------
bearer = BearerTokenAuth(Token=data)
python_3 = GhPythonScript(
    buildingAndTerrainHeightArray=nickname.ApiBuilding,
    terrainHeightArray=nickname.ApiTerrain,
    minHeight=nickname.ApiMin,
    maxHeight=nickname.ApiMax)  # -> out, a; inputs buildingAndTerrainHeightArray: list of Int32, terrainHeightArray: list of Int32
# ---------- python_3: Python ----------
__author__ = "ARZE"
__version__ = "2024.02.14"

import rhinoscriptsyntax as rs
import json

heightMaps  = {
        "terrainHeightArray": terrainHeightArray,
        "minHeight": minHeight,
        "maxHeight": maxHeight,
        "buildingAndTerrainHeightArray":buildingAndTerrainHeightArray
    }
    
    
a = json.dumps(heightMaps)
# ---------- end python_3 ----------
python_4 = GhPythonScript()  # -> out, endPoint
# ---------- python_4: Python ----------
__author__ = "ARZE"
__version__ = "2024.02.14"

import rhinoscriptsyntax as rs
ghenv.Component.Message = "Wind params end point"
endPoint  = "https://developer.api.autodesk.com/forma/wind-prediction/v1alpha/parameters"
# ---------- end python_4 ----------
ch = CreateHttpHeader(Key=python.key, Value=python.value)
cqp = CreateQueryParam(Key=python_2.key, Value=python_2.value)
merge = Merge(Data1=bearer, Data2=ch)
get = GETRequest(URL=python_4.endPoint, Params=cqp, Headers=merge)  # -> Status, Content, Response
panel_2 = Panel(get.Status)
python_5 = GhPythonScript(wind_param=get.Content, a=python_3.a)  # -> out, body_dump
# ---------- python_5: Python ----------
import rhinoscriptsyntax as rs
import json
import gzip
import zlib

body = dict()
type = "comfort"
#"roughness": 0.6065,
comfortScale = "lawson_lddc"


wind_param_parts = json.loads(wind_param)
roughness = wind_param_parts["roughness"]

    
    
heightMaps = json.loads(a)
    
del wind_param_parts["roughness"]


body["heightMaps"] = heightMaps
body["windRose"] = wind_param_parts
body["type"] = type
body["roughness"] = roughness
body["comfortScale"] = comfortScale

body_dump = json.dumps(body)


output_file_path = r"C:\Users\Arze\Downloads\output.json"
with gzip.open(output_file_path, 'wb') as f:
    f.write(body_dump)
# ---------- end python_5 ----------
merge_2 = Merge(Data1=bearer, Data2=ch)
ctb = CreateTextBody(
    Content=python_5.body_dump,
    IsHtmlChecked=False,
    IsJavascriptChecked=False,
    IsJsonChecked=True,
    IsTextChecked=False,
    IsXmlChecked=False)
python_6 = GhPythonScript()  # -> out, endPoint
# ---------- python_6: Python ----------
__author__ = "ARZE"
__version__ = "2024.02.14"

import rhinoscriptsyntax as rs
ghenv.Component.Message = "Predict end point"
endPoint  = "https://developer.api.autodesk.com/forma/wind-prediction/v1alpha/predict"
# ---------- end python_6 ----------
post = POSTRequest(URL=python_6.endPoint, Body=ctb, Params=cqp, Headers=merge_2)  # -> Status, Content, Response
panel_3 = Panel(post.Status)
dejson = DeserializeJson(JSON=post.Content, OutputsLocked=False)
bnd = Bounds(Numbers=dejson)
range = Range(Domain=Domain(0, 1), Steps=10)
gradient = Gradient(
    LowerLimit="0",
    UpperLimit="2",
    Parameter=range,
    stops=[0: RGB(234, 38, 0), 0.25: RGB(234, 126, 0), 0.5: RGB(254, 244, 84), 0.75: RGB(173, 203, 249), 1: RGB(75, 107, 169)])
prob = Data()
python_7 = GhPythonScript(x=prob)  # -> out, a
# ---------- python_7: Python ----------
__author__ = "ARZE"
__version__ = "2024.02.14"

import rhinoscriptsyntax as rs
a = x.DrapedResultMesh
# ---------- end python_7 ----------
recolor_mesh = RecolorMesh(Mesh=python_7.a, Result=dejson, ListOfColors=gradient, Segments=10)  # -> ColoredMesh, Colors, Values
